# Grasshopper definition rpc_test.gh (Grasshopper 1.0.7)

ghpython_script = GhPythonScript(restart=Toggle(False))  # -> out, a; inputs restart: Boolean
# ---------- ghpython_script: Python ----------
from compas.rpc import Proxy

# debug and print mode not working for this...
#with Proxy('compas_rpc_example.test_demo', python='python', capture_output=False) as p:
#    a = p.test_connect()
#    print a

#with Proxy('compas_rpc_example') as p:
#    a = p.test_connect()
#    print a6

# debug mode not working if used like this?
p = Proxy('compas_rpc_example')
print p.address

if restart:
    p.stop_server()
    p.start_server()

a = p.test_connect()
print a
# ---------- end ghpython_script ----------
panel = Panel(ghpython_script.out)
